# Dynamo graph ProjectOnTo.dyn (Dynamo 2.1.0.7500)

number_slider = DoubleSlider(6.16, range=0..10 step 0.01)
byCoordinates = Point.ByCoordinates(x=number_slider, y=number_slider)
asVector = Point.AsVector(point=byCoordinates)
YAxis = Vector.YAxis()
byOriginNormal = Plane.ByOriginNormal(normal=YAxis)
projectToPlane = Custom[Vector.ProjectToPlane](vector=asVector, plane=byOriginNormal)  # Find the projection of the vector to the specified plane.
asPoint = Vector.AsPoint(vector=projectToPlane)
