# Dynamo graph 02. Duplicate Views,Cropregion, Annotation Region, Place.dyn (Dynamo 2.0.3.8810)

views = Views()  # nothing selected
# note: Script Name: 02. Duplicate Views,Cropregion, Annotation Region, Place.dyn
# Packages used in this script:
# Clockwork for Dynamo 1.x version: 1.31.1
# Clockwork for Dynamo 2.x version: 2.1.2
# Rhythm version: 2019.9.12
# archi-lab.net version: 2018.0.8
# SteamNodes version: 1.2.4
# bimorphNodes version: 2.5.1
# TimeStamp : 2019/10/23 20:15
string = StringInput("Woningtype")
code_block = CodeBlock { " "; }

# group: Get unique appartment numbers from Schedule
# note: 00_Begane Grond
views_2 = Views(index=13)
boolean = BoolSelector(true)
boolean_2 = BoolSelector(false)
code_block_2 = CodeBlock { 0; }

getData = Revit.Schedule.GetData(scheduleView=views_2, removeHeading=boolean, refresh=boolean_2)

# group (continued): Get unique appartment numbers from Schedule
transpose = List.Transpose(lists=getData)
getItemAtIndex = List.GetItemAtIndex(list=transpose, index=code_block_2)
uniqueItems = List.UniqueItems(list=getItemAtIndex)

code_block_3 = CodeBlock(a=string, b=code_block, c=uniqueItems) { a+b+c; }
duplicate_options = DuplicateOptionsUi(index=0)
duplicate = archilab.Revit.Views.View.Duplicate(view=views, name=code_block_3, options=duplicate_options)

# group: SetCropRegion [probleem !]
categories = Categories(index=403)  # frozen
all_elements_of_category = ElementsOfCategory(Category=categories)
string_2 = StringInput("Woning Nummer")
getParameterValueByName = Element.GetParameterValueByName(element=all_elements_of_category, parameterName=string_2)
string_3 = StringInput("A.01")
contains = String.Contains(str=getParameterValueByName, searchFor=string_3)
filterByBoolMask = List.FilterByBoolMask(list=all_elements_of_category, mask=contains)
flatten = List.Flatten(list=filterByBoolMask.in)
countOccurences = Custom[List.CountOccurences](seq=getParameterValueByName)  # Counts the number of occurences of each unique element in a given list
chop = List.Chop(list=all_elements_of_category, lengths=countOccurences.count)
byElements = Custom[BoundingBox.ByElements](boundingBoxes=chop)  # Merges a list of bounding boxes into a single bounding box
number = DoubleInput(1.1)
scale = Custom[Springs.BoundingBox.Scale](boundingBox=byElements, xAmmount=number, yAmmount=number, zAmmount=number)  # Scales the bounding box in three dimensions according to it's center.
setCropRegion = Rhythm.Revit.Views.View.SetCropRegion(view=duplicate, bBox=scale)

string_4 = StringInput("Scope Boxes")
byName = Category.ByName(name=string_4)
all_elements_of_category_2 = ElementsOfCategory(Category=byName)
name = Element.Name(element=all_elements_of_category_2)
string_5 = StringInput("Woningtype")
contains_2 = String.Contains(str=name, searchFor=string_5)
filterByBoolMask_2 = List.FilterByBoolMask(list=all_elements_of_category_2, mask=contains_2)
watch = Watch(filterByBoolMask_2.in)
number_2 = DoubleInput(3)
python_script = Python(IN[0]=duplicate, IN[1]=number_2, IN[2]=number_2, IN[3]=number_2, IN[4]=number_2)
# ---------- python_script.python (38 lines) ----------
import clr
clr.AddReference("RevitNodes")
import Revit

clr.AddReference("RevitServices")
import RevitServices
from RevitServices.Persistence import DocumentManager
from RevitServices.Transactions import TransactionManager
doc = DocumentManager.Instance.CurrentDBDocument

#The inputs to this node will be stored as a list in the IN variables.
if isinstance(IN[0], list):
	views = UnwrapElement(IN[0])
else:
	views = [UnwrapElement(IN[0])]
Bottom = IN[1]
Left = IN[2]
Right = IN[3]
Top = IN[4]
p = 304.8	
plans = []
for view in views:
	regionMan = view.GetCropRegionShapeManager()
	TransactionManager.Instance.EnsureInTransaction(doc)
	try:
		regionMan.BottomAnnotationCropOffset = Bottom/p
		regionMan.LeftAnnotationCropOffset = Left/p
		regionMan.RightAnnotationCropOffset = Right/p
		regionMan.TopAnnotationCropOffset = Top/p
		plans.append(view)
	except:
		plans.append("failed")
	
	TransactionManager.Instance.TransactionTaskDone()


#Assign your output to the OUT variable.
OUT = plans
# ----------------------------------------
number_3 = DoubleInput(0)
number_4 = DoubleInput(0)
number_5 = DoubleInput(0)
byCoordinates = Point.ByCoordinates(x=number_3, y=number_4, z=number_5)
create = Rhythm.Revit.Elements.Viewport.Create(sheet=watch, view=python_script, location=byCoordinates)
viewport_properties = Custom[Viewport Properties](Viewport=create)  # This node will return certain properties from a Viewport input.
code_block_4 = CodeBlock { 0; }
byCoordinates_2 = Point.ByCoordinates(x=code_block_4, y=code_block_4, z=code_block_4)
X = Point.X(point=viewport_properties)
boolean_3 = BoolSelector(true)
code_block_5 = CodeBlock(a=boolean_3) { 2; a; }
mul = X * code_block_5.out0
Y = Point.Y(point=viewport_properties)
mul_2 = Y * code_block_5.out0
Z = Point.Z(point=viewport_properties)
mul_3 = Z * code_block_5.out0
byCoordinates_3 = Point.ByCoordinates(x=mul, y=mul_2, z=mul_3)
byTwoPoints = Vector.ByTwoPoints(start=byCoordinates_2, end=byCoordinates_3)
subtract = Point.Subtract(point=viewport_properties, vectorToSubtract=byTwoPoints)
code_block_6 = CodeBlock { 0; }
byCoordinates_4 = Point.ByCoordinates(x=code_block_6, y=code_block_6, z=code_block_6)
number_6 = DoubleInput(0)
number_7 = DoubleInput(2)
mul_4 = Y * number_7
number_8 = DoubleInput(297)
add = mul_4 + number_8
number_9 = DoubleInput(0)
byCoordinates_5 = Point.ByCoordinates(x=number_6, y=add, z=number_9)
byTwoPoints_2 = Vector.ByTwoPoints(start=byCoordinates_4, end=byCoordinates_5)
add_2 = Point.Add(point=subtract, vectorToAdd=byTwoPoints_2)
setBoxCenter = Custom[Viewport.SetBoxCenter](Points=add_2, Viewport_list=create)  # API class
