# Dynamo graph String.Separator.dyn (Dynamo 2.1.0.7500)

select_model_elements = DSModelElementsSelection()  # 330 picked in the model
list_create = List.Create(item0=select_model_elements)
code_block = CodeBlock(x=list_create) { x.Id; }
flatten = List.Flatten(list=code_block)
code_block_2 = CodeBlock(l=flatten)
# ---------- code_block_2.designscript (9 lines) ----------
n = DSCore.List.Count(l);
result = l[0];
separator =",";
[Imperative]{
	for (i in 1..n-1){
		result = result + separator + l[i];
		}
	return = result;
};
# ----------------------------------------
sendTo = Custom[Clipboard.SendTo](str=code_block_2.out3)  # Copies a string to the clipboard.
